# Grasshopper definition Blocks-example.gh (Grasshopper 1.0.7)
# plug-ins: Blocks

id = Guid([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])
read_assembly = ReadAssembly(InstanceObjects=id, DistanceThreshold=Slider(50, range=0..100))
mesh = Mesh(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)
nickname = CreateAssembly(Assembly=read_assembly, Obstacles=mesh, Steps=Slider(131, range=0..200), Seed=Slider(37, range=0..100))  # -> BlockInstance, Geometry, PlacementXforms
preview = CustomPreview(
    Geometry=nickname.Geometry,
    Material={diffuse=RGB(221, 160, 221), emission=RGB(66, 48, 66), shine=0.5, specular=RGB(255, 255, 255), transparency=0})
