# Grasshopper definition Blocks.gh (Grasshopper 1.0.7)
# plug-ins: Blocks

id = Guid([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])
nickname = ReadBlocks(Blocks=id, DistanceThreshold=Slider(50, range=0..100))
mesh = Mesh(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)
python = GhPythonScript(x=nickname)  # -> out, a
# ---------- python: Python ----------
a = [i.Probability for i in x]
# ---------- end python ----------
panel = Panel(python.a)
nickname_2 = CreateAssembly(BlockPool=nickname, Obstacles=mesh, Iterations=Slider(63, range=0..200), Seed=Slider(51, range=0..100))  # -> BlockInstance, Geometry, PlacementXforms
preview = CustomPreview(
    Geometry=nickname_2.Geometry,
    Material={diffuse=RGB(221, 160, 221), emission=RGB(66, 48, 66), shine=0.5, specular=RGB(255, 255, 255), transparency=0})
